# Grasshopper definition SpiralSurfaceWithReverse.gh (Grasshopper 0.9.76)
# plug-ins: WolframComponents

wolfram_f_x = WolframFX(Head="(Reverse /@ ToExpression[#])&", Arg="Table[t{Cos[t],Sin[t],2},{t,0.,8Pi,Pi/64.}]")  # -> Result, ExprResult, Link
to_rhino_point3d_list = ToRhinoPoint3dList(Pts="Table[t{Cos[t],Sin[t],1},{t,0.,8Pi,Pi/64.}]")  # -> P3D, Link
to_rhino_point3d_list_2 = ToRhinoPoint3dList(Pts=wolfram_f_x.Result)  # -> P3D, Link
ln = Line(StartPoint=to_rhino_point3d_list.P3D, EndPoint=to_rhino_point3d_list_2.P3D)
loft = Loft(Curves=ln, Options={Adjust=False, Closed=False, LoftEnds=0, LoftSimp=0, LoftType=0, Rebuild=10, Refit=0.01})
