# Grasshopper definition RheotomicSurface.gh (Grasshopper 0.9.76)
# plug-ins: RheotomicSurface

rheotomicsurface = RheotomicSurface(
    WeightedPoints="{{{0,0},1},{{1,0},-1},{{0,10},-1},{{1,10},1}}",
    Scaling=Slider(0.208, range=0..1),
    Range="{{-2,2},{-2,12}}",
    NumberOfSurfaces=Slider(3, range=1..5),
    CurveDistance=Slider(0.1, range=0.1..1))  # -> Surfaces, Points, ExprResult, Link
cyl = Cylinder(Base=rheotomicsurface.Points, Radius=Slider(0.125, range=0..1), Length=Slider(3.375, range=0..10))
preview = CustomPreview(
    Geometry=rheotomicsurface.Surfaces,
    Shader={ambient=RGB(0, 0, 0), diffuse=RGB(255, 105, 180), emission=RGB(76, 32, 54), shine=0.5, specular=RGB(255, 255, 255), transparency=0})
cap = CapHoles(Brep=cyl)
