# Grasshopper definition TilingTest.gh (Grasshopper 0.9.76)
# plug-ins: Tiling

number_slider = Slider(4, range=0..10)
brep = Brep(<brep referenced from the Rhino model>)
hsl = ColourHSL(Alpha=1, Hue=0, Saturation=0, Luminance=0.5)
tiling = Tiling(Obj=brep, R=number_slider, C=number_slider)  # -> Tiling, Debug, ExprResult, Link
material = CreateMaterial(Diffuse=hsl, Specular=hsl, Emission=hsl, Transparency=Slider(0, range=0..1), Shine=0)
preview = CustomPreview(Shader=material)
