# Grasshopper definition UVSurfaceComponentExample.gh (Grasshopper 0.9.76)
# plug-ins: UVSurface1

number_slider = Slider(14, range=0..20)
uvsurface1 = UVSurface1(Expr="Table[{u, v, # Sin[u]Sin[v]}, {u, -3,3,.3}, {v, -3,3,.3}]", X=Slider(1.224, range=-2..2))  # -> Surface, ExprResult, Link
sdivide = DivideSurface(Surface=uvsurface1.Surface, UCount=number_slider, VCount=number_slider)  # -> Points, Normals, Parameters
circle = CircleCNR(Center=sdivide.Points, Normal=sdivide.Normals, Radius=Slider(0.2, range=0..0.5))
project = Project(Curve=circle, Brep=uvsurface1.Surface, Direction=Vector(0, 0, 1))
